# Grasshopper definition frame.gh (Grasshopper 1.0.7)

crv = Curve(<curve referenced from the Rhino model>)
crv_2 = Curve([<curve referenced from the Rhino model> x6])
boundary = BoundarySurfaces(Edges=crv)
crv_3 = Curve(<curve referenced from the Rhino model>)
Z = UnitZ(Factor=Slider(20, range=0..100))
boundary_2 = BoundarySurfaces(Edges=crv_2)
Z_2 = UnitZ(Factor=Slider(30, range=0..100))
Z_3 = UnitZ(Factor=Slider(25, range=0..100))
extr = Extrude(Base=boundary, Direction=Z)
boundary_3 = BoundarySurfaces(Edges=crv_3)
extr_2 = Extrude(Base=boundary_2, Direction=Z_2)
extr_3 = Extrude(Base=boundary_3, Direction=Z_3)
join = BrepJoin(Breps=[extr, extr_2, extr_3])  # -> Breps, Closed
preview = CustomPreview(
    Geometry=join.Breps,
    Material={diffuse=RGB(221, 160, 221), emission=RGB(66, 48, 66), shine=0.5, specular=RGB(255, 255, 255), transparency=0})
